# Grasshopper definition basic.gh (Grasshopper 1.0.7)
# plug-ins: SimScale 

download = DownloadAndProcessResults(
    ProjectName="Grasshopper Integration Example - API",
    SimulationName="Boston",
    SimulationRunName="16 - Direction, corrected Exposure",
    Run=Toggle(False))
speeds = CollectWindSpeeds(SimScaleObject=download, WindDirection="210", SpeedMultiplier="5")
convert = VTUToRhinoMesh(VTUFilePath=speeds)  # -> Mesh, DataValues
heatmap = LBSpatialHeatmap(values=convert.DataValues, mesh=convert.Mesh)  # -> mesh, legend, title, colors, legend_par; plug-in component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
